% Requirement links of Avionics_tests.m (R2025b)

% line 3 verifies Missile_Reqs.slreqx#30
        function IgnitionSystem(testCase)

% line 13 verifies Missile_Reqs.slreqx#31
        function Software(testCase)

% line 22 verifies Missile_Reqs.slreqx#32
        function Connection_standard(testCase)

% line 30 verifies Missile_Reqs.slreqx#33
        function Power_Standard(testCase)

% line 38 verifies Missile_Reqs.slreqx#34
% line 38 verifies Missile_Reqs.slreqx#11
        function Datalink(testCase)

% line 45 verifies Missile_Reqs.slreqx#36
        function Electromagnetic_Resistance(testCase)