% Requirement links of Weight_Tests.m (R2025b)

% line 6 verifies Missile_Reqs.slreqx#8
% line 6 verifies Missile_Reqs.slreqx#6
% line 6 verifies Missile_Reqs.slreqx#5
        function HIMARS_Fighter(testCase)

% line 10 verifies Missile_Reqs.slreqx#7
        function submarine(testCase)

% line 14 verifies Missile_Reqs.slreqx#4
        function mark41VLS(testCase)